# Dynamo custom node RedHotBIM.Algorithm.Search - Search.MinMaxOnCurve.dyf "RHB Search.MinMaxOnCurve" (Dynamo 0.8.2.2150)
# category: RedHotBIM.Algorithm.Search
# Search Min Max Point on a Curve

curve = Input()
vector = Input(vector : Vector)
population = Input(population : int = 20)
division = Input(division : int = 20)
py_minmaxoncurve = Python(IN[0]=curve, IN[1]=vector, IN[2]=population, IN[3]=division)
# ---------- py_minmaxoncurve.python (118 lines) ----------
import clr
clr.AddReference('ProtoGeometry')
from Autodesk.DesignScript.Geometry import *

import sys
sys.path.append("C:\Program Files (x86)\IronPython 2.7\Lib")
import random
import math

class FindPoint:
	def __init__(self, curve, directionVector, population, division):
		self.crv = curve
		self.pop = population
		self.div = division
		
		self.axis = 0 #X Y Z 0 1 2
		self.minMax = 0 #MIN MAX 0 1
		self.dir = ""
		
		
		if directionVector.Z == -1:
			self.axis = 2
			self.minMax = 0
			self.dir = "Z Min"
		elif directionVector.Z == 1:
			self.axis = 2
			self.minMax = 1
			self.dir = "Z Max"
		elif directionVector.Y == -1:
			self.axis = 1
			self.minMax = 0
			self.dir = "Y Min"
		elif directionVector.Y == 1:
			self.axis = 1
			self.minMax = 1
			self.dir = "Y Max"
		elif directionVector.X == -1:
			self.axis = 0
			self.minMax = 0
			self.dir = "X Min"
		else:
			self.axis = 0
			self.minMax = 1
			self.dir = "X Max"
		
		
		self.data = [[self.dir,0.0,1.0,None,[]]] #directionString paramMin paramMax zMax stringList
		self.run()
		
	def divideDomain(self):
		dir = self.data[0][0]
		pMin = self.data[0][1]
		pMax = self.data[0][2]
		stLPrevious = self.data[0][4]
		
		pRange = pMax - pMin
		newData = []
		
		for i in range(self.div):
			stL = stLPrevious + ["Division: %d/%d" % (i+1,self.div)]
			pMn = ((i) * pRange / self.div) + pMin
			pMx = ((i+1) * pRange / self.div) + pMin
			xyzMinMax = self.shootPtsGetMinMax(pMn, pMx)
			newData.append([dir,pMn,pMx,xyzMinMax,stL])
		self.data = newData
	
	def findMinMaxDomain(self):
		xyzMinMaxCandidate = None
		datum = None
		for dat in self.data:
			if xyzMinMaxCandidate == None:
				xyzMinMaxCandidate = dat[3]
				datum = dat
			if self.minMax == 1:
				if xyzMinMaxCandidate < dat[3]:
					xyzMinMaxCandidate = dat[3]
					datum = dat
			else:
				if xyzMinMaxCandidate > dat[3]:
					xyzMinMaxCandidate = dat[3]
					datum = dat
		self.data = [datum]
	
	def shootPtsGetMinMax(self, pMin, pMax):
		xyzList = []
		for i in range(self.pop):
			p = random.uniform(pMin, pMax)
			pt = self.crv.PointAtParameter(p)
			xyz = pt.Z
			if self.axis == 0:
				xyz = pt.X
			if self.axis == 1:
				xyz = pt.Y
				
			xyzList.append(xyz)
		if self.minMax == 1:
			return max(xyzList)
		else:
			return min(xyzList)
		
	def run(self):
		previousXYZMax = None
		while True:
			previousXYZMax = self.data[0][3]
			self.divideDomain()
			self.findMinMaxDomain()
			if previousXYZMax == self.data[0][3]:
				break
		
#The inputs to this node will be stored as a list in the IN variable.
curve = IN[0]
directionVector = IN[1]
population = IN[2]
division = IN[3]

fp = FindPoint(curve, directionVector, population, division)
#Assign your output to the OUT variable
OUT = fp.data[0]
# ----------------------------------------
code_block = CodeBlock(a=py_minmaxoncurve) { a[3]; }
Value = Output(code_block)
Data_List = Output(py_minmaxoncurve)
