# Dynamo custom node RedHotBIM.Algorithm.Search - Search.MinMaxOnSurface.dyf "RHB Search.MinMaxOnSurface" (Dynamo 0.8.2.2150)
# category: RedHotBIM.Algorithm.Search
# Search Min Max Point on a Surface

surface = Input()
vector = Input(vector : Vector)
population = Input(population : int = 20)
divisionX = Input(divisionX : int = 10)
divisionY = Input(divisionY : int = 10)
py_minmaxonsurface = Python(IN[0]=surface, IN[1]=vector, IN[2]=population, IN[3]=divisionX, IN[4]=divisionY)
# ---------- py_minmaxonsurface.python (132 lines) ----------
import clr
clr.AddReference('ProtoGeometry')
from Autodesk.DesignScript.Geometry import *

import sys
sys.path.append("C:\Program Files (x86)\IronPython 2.7\Lib")
import random
import math

class FindPoint:
	def __init__(self, surface, directionVector, population, divisionX, divisionY):
		self.srf = surface
		self.pop = population
		self.divX = divisionX
		self.divY = divisionY
		
		self.axis = 0 #X Y Z 0 1 2
		self.minMax = 0 #MIN MAX 0 1
		self.dir = ""
		
		
		if directionVector.Z == -1:
			self.axis = 2
			self.minMax = 0
			self.dir = "Z Min"
		elif directionVector.Z == 1:
			self.axis = 2
			self.minMax = 1
			self.dir = "Z Max"
		elif directionVector.Y == -1:
			self.axis = 1
			self.minMax = 0
			self.dir = "Y Min"
		elif directionVector.Y == 1:
			self.axis = 1
			self.minMax = 1
			self.dir = "Y Max"
		elif directionVector.X == -1:
			self.axis = 0
			self.minMax = 0
			self.dir = "X Min"
		else:
			self.axis = 0
			self.minMax = 1
			self.dir = "X Max"
		
		
		self.data = [[self.dir,0.0,1.0,0.0,1.0,None,[]]] #directionString paramMin paramMax zMax stringList
		self.run()
		
	def divideDomain(self):
		dir = self.data[0][0]
		uMin = self.data[0][1]
		uMax = self.data[0][2]
		vMin = self.data[0][3]
		vMax = self.data[0][4]
		stLPrevious = self.data[0][6]
		
		uRange = uMax - uMin
		vRange = vMax - vMin
		newData = []
		
		for i in range(self.divX):
			for j in range(self.divY):
			
				stL = stLPrevious + ["Division X: %d/%d Y: %d/%d" % (i+1,self.divX,j+1,self.divY)]
				
				uMn = ((i) * uRange / self.divX) + uMin
				uMx = ((i+1) * uRange / self.divX) + uMin
				
				vMn = ((j) * vRange / self.divX) + vMin
				vMx = ((j+1) * vRange / self.divX) + vMin
				
				xyzMinMax = self.shootPtsGetMinMax(uMn, uMx, vMn, vMx)
				newData.append([dir,uMn,uMx,vMn,vMx,xyzMinMax,stL])
		self.data = newData
	
	def findMinMaxDomain(self):
		xyzMinMaxCandidate = None
		datum = None
		for dat in self.data:
			if xyzMinMaxCandidate == None:
				xyzMinMaxCandidate = dat[5]
				datum = dat
			if self.minMax == 1:
				if xyzMinMaxCandidate < dat[5]:
					xyzMinMaxCandidate = dat[5]
					datum = dat
			else:
				if xyzMinMaxCandidate > dat[5]:
					xyzMinMaxCandidate = dat[5]
					datum = dat
		self.data = [datum]
	
	def shootPtsGetMinMax(self, uMn, uMx, vMn, vMx):
		xyzList = []
		for i in range(self.pop):
			u = random.uniform(uMn, uMx)
			v = random.uniform(vMn, vMx)
			pt = self.srf.PointAtParameter(u,v)
			xyz = pt.Z
			if self.axis == 0:
				xyz = pt.X
			if self.axis == 1:
				xyz = pt.Y
				
			xyzList.append(xyz)
		if self.minMax == 1:
			return max(xyzList)
		else:
			return min(xyzList)
		
	def run(self):
		previousXYZMax = None
		while True:
			previousXYZMax = self.data[0][5]
			self.divideDomain()
			self.findMinMaxDomain()
			if previousXYZMax == self.data[0][5]:
				break
		
#The inputs to this node will be stored as a list in the IN variable.
surface = IN[0]
directionVector = IN[1]
population = IN[2]
divisionX = IN[3]
divisionY = IN[4]

fp = FindPoint(surface, directionVector, population, divisionX, divisionY)

#Assign your output to the OUT variable
OUT = fp.data[0]
# ----------------------------------------
code_block = CodeBlock(a=py_minmaxonsurface) { a[5]; }
Value = Output(code_block)
Data_List = Output(py_minmaxonsurface)
