# Dynamo custom node RedHotBIM.Geometry.BoundingBox - BoundingBox.Show.dyf "RHB BoundingBox.Show" (Dynamo 0.8.2.2392)
# category: RedHotBIM.Geometry.BoundingBox
# Shows the BoundingBox

boundingBox = Input(boundingBox : BoundingBox)
code_block = CodeBlock(bb=boundingBox)
# ---------- code_block.designscript (4 lines) ----------
crvGeom = bb.ToCuboid().Edges.CurveGeometry;
ptStart = crvGeom.StartPoint;
ptEnd = crvGeom.EndPoint;
lines = Line.ByStartPointEndPoint(ptStart,ptEnd);
# ----------------------------------------
Lines = Output(code_block.lines)
maxPoint = BoundingBox.MaxPoint(boundingBox)
MaxPoint = Output(maxPoint)
minPoint = BoundingBox.MinPoint(boundingBox)
MinPoint = Output(minPoint)
contextCoordinateSystem = BoundingBox.ContextCoordinateSystem(boundingBox)
CoordinateSystem = Output(contextCoordinateSystem)
