# Dynamo custom node RedHotBIM.Geometry.Point - Point.SortByAngle.dyf "RHB Point.SortByAngle" (Dynamo 0.8.2.2392)
# category: RedHotBIM.Geometry.Point
# Sorts Points by Angle

listToBeOrdered = Input()
pointList = Input()
originPoint = Input(originPoint : Point)
py_order = Python(IN[0]=pointList, IN[1]=originPoint)
# ---------- py_order.python (46 lines) ----------
import clr
clr.AddReference('ProtoGeometry')
from Autodesk.DesignScript.Geometry import *

clr.AddReference("RevitNodes")
import Revit
from Revit.Elements import *
import math
#The inputs to this node will be stored as a list in the IN variable.
pts = UnwrapElement(IN[0])
org = UnwrapElement(IN[1])
ang = []
		
for p in pts:
	if ((p.X == org.X) and (p.Y == org.Y)):
		ang.insert(0,-1)
		continue
	if (p.Y - org.Y) == 0:
		if (p.X - org.X) > 0:
			ang.append(0)
		else:
			ang.append(180)
	if (p.X - org.X) == 0:
		if (p.Y - org.Y) > 0:
			ang.append(90)
		else:
			ang.append(270)
			
	#01 ++
	if (p.X - org.X) > 0 and (p.Y - org.Y) > 0:
		ang.append(math.atan((p.Y - org.Y) / (p.X - org.X))*180/math.pi)
	
	#02 -+
	if (p.X - org.X) < 0 and (p.Y - org.Y) > 0:
		ang.append((math.atan((p.Y - org.Y) / (p.X - org.X))*180/math.pi)+180)
		
	#03 --
	if (p.X - org.X) < 0 and (p.Y - org.Y) < 0:
		ang.append((math.atan((p.Y - org.Y) / (p.X - org.X))*180/math.pi)+180)
	
	#04 +-
	if (p.X - org.X) > 0 and (p.Y - org.Y) < 0:
		ang.append((math.atan((p.Y - org.Y) / (p.X - org.X))*180/math.pi)+360)
	
#Assign your output to the OUT variable
OUT = ang
# ----------------------------------------
clockWise = Input(clockWise : bool = true)
not_ = Not(clockWise)
sortIndexByValue = SortIndexByValue(py_order, not_)
reorder = Reorder(listToBeOrdered, sortIndexByValue)
Output = Output(reorder)  # ""
