# Dynamo custom node RedHotBIM.Geometry.Vector - Vector.AngleBetween.dyf "RHB Vector.AngleBetween" (Dynamo 0.8.2.2150)
# category: RedHotBIM.Geometry.Vector
# Angle Between Two Vectors

vectorA = Input(vectorA : Vector)
vectorB = Input(vectorB : Vector)
python_script = Python(IN[0]=vectorA, IN[1]=vectorB)
# ---------- python_script.python (23 lines) ----------
import clr
clr.AddReference('ProtoGeometry')
from Autodesk.DesignScript.Geometry import *
import math

def dotproduct(v1, v2):
	v1e = [v1.X, v1.Y, v1.Z]
	v2e = [v2.X, v2.Y, v2.Z]
	return sum((a*b) for a, b in zip(v1e, v2e))

def lengthV(v):
	return math.sqrt(dotproduct(v, v))

def angleBetweenVectors(v1, v2):
	return math.acos(dotproduct(v1, v2) / (lengthV(v1) * lengthV(v2)))

#The inputs to this node will be stored as a list in the IN variable.
dataEnteringNode = IN

v1 = UnwrapElement(IN[0])
v2 = UnwrapElement(IN[1])
#Assign your output to the OUT variable
OUT = angleBetweenVectors(v1, v2)
# ----------------------------------------
code_block = CodeBlock(radian=python_script) { 180.0 * radian / Math.PI; }
Angle_degree = Output(code_block)  # "Angle (degree)"
Angle_radian = Output(python_script)  # "Angle (radian)"
