# Dynamo custom node RedHotBIM.Geometry.Vector - Vector.Bisector.dyf "RHB Vector.Bisector" (Dynamo 0.8.2.2150)
# category: RedHotBIM.Geometry.Vector
# Normalized Vector of Angle Bisector

vectorA = Input(vectorA : Vector)
vectorB = Input(vectorB : Vector)
code_block = CodeBlock(vectorA=vectorA, vectorB=vectorB)
# ---------- code_block.designscript (5 lines) ----------
ptOr = Point.Origin();
pt1 = ptOr.Translate(vectorA,1);
pt2 = ptOr.Translate(vectorB,1);
ptMid = Line.ByStartPointEndPoint(pt1,pt2).PointAtParameter(0.5);
vec = Vector.ByTwoPoints(ptOr, ptMid).Normalized();
# ----------------------------------------
Bisector = Output(code_block.vec)
