# Dynamo custom node RedHotBIM.Geometry.Vector - Vector.Show.dyf "RHB Vector.Show" (Dynamo 0.8.2.2392)
# category: RedHotBIM.Geometry.Vector
# Show Vector

normalize = Input(normalize : bool = false)
vector = Input(vector : Vector)
startPoint = Input(startPoint : Point)
code_block = CodeBlock(normalize=normalize, vec=vector, pt=startPoint)
# ---------- code_block.designscript (8 lines) ----------
normalize;
len = normalize ? 1 : vec.Length;
line = Line.ByStartPointDirectionLength(pt, vec, len);
llen = line.Length;
coneStartPt = line.PointAtDistance(llen *8/10);
coneEndPt = line.EndPoint;
cone = Cone.ByPointsRadius(coneStartPt,coneEndPt, llen /20);
vecOut = normalize ? vec.Normalized() : vec;
# ----------------------------------------
EndPoint = Output(code_block.coneEndPt)
Vector = Output(code_block.vecOut)
X = Vector.X(code_block.vecOut)
X_2 = Output(X)  # "X"
Y = Vector.Y(code_block.vecOut)
Y_2 = Output(Y)  # "Y"
Z = Vector.Z(code_block.vecOut)
Z_2 = Output(Z)  # "Z"
length = Vector.Length(code_block.vecOut)
Length = Output(length)
create = List.Create(code_block.line, code_block.cone)
Visual = Output(create)
